# Grasshopper definition UnitTests.gh (Grasshopper 1.0.7)
# plug-ins: Gatekeeper

pass = BooleanToggle(False)
# Data Tree
repeat_data = RepeatData(Data=pass, Length=Slider(3, range=0..10))  # -> graft(Data)
gatekeeper = Gatekeeper(Data=Slider(4, range=0..10), Pass=repeat_data, UpdateOutput=False)
panel = Panel(gatekeeper)

pass_2 = BooleanToggle(False)
# In this test, we validate that the data does not propagate, if the gatekeepers are chained in series.
# Every data recorder should record only a single value.
value = BooleanToggle(True)
gatekeeper_2 = Gatekeeper(Data=value, Pass=pass_2, UpdateOutput=False)
gatekeeper_3 = Gatekeeper(Data=gatekeeper_2, Pass=pass_2, UpdateOutput=False)
gatekeeper_4 = Gatekeeper(Data=gatekeeper_3, Pass=pass_2, UpdateOutput=False)
data_recorder = DataRecorder(gatekeeper_2, DataLimit=-10, RecordData=True)
data_recorder_2 = DataRecorder(gatekeeper_3, DataLimit=-10, RecordData=True)
data_recorder_3 = DataRecorder(gatekeeper_4, DataLimit=-10, RecordData=True)
panel_2 = Panel(data_recorder)
panel_3 = Panel(data_recorder_2)
panel_4 = Panel(data_recorder_3)

data = Slider(3, range=0..10)
gate_or = GateOr(A=Button(), B=Toggle(False))
gatekeeper_5 = Gatekeeper(Data=data, Pass=gate_or, UpdateOutput=False)
c_script = CSharpScript(x=gatekeeper_5)  # -> out, A
# ---------- c_script: C# usings ----------
using System.Threading;
# ---------- c_script: C# ----------
    Thread.Sleep(500);
    A = x;
# ---------- end c_script ----------
panel_5 = Panel(c_script.A)

data_2 = Slider(4, range=0..10)
gate_or_2 = GateOr(A=Button(), B=Toggle(False))
gatekeeper_6 = Gatekeeper(Data=data_2, Pass=gate_or_2, UpdateOutput=True)
c_script_2 = CSharpScript(x=gatekeeper_6)  # -> out, A; same code as c_script
panel_6 = Panel(c_script_2.A)

# ----
# The component should turn red, if the user is providing more than one boolean value for the Pass argument
data_3 = Slider(4, range=0..10)
# List
gatekeeper_7 = Gatekeeper(Data=data_3, Pass=[Toggle(False), Toggle(False)], UpdateOutput=False)
panel_7 = Panel(gatekeeper_7)

value_2 = BooleanToggle(False)
pass_3 = BooleanToggle(True)
ghpython_script = GhPythonScript(x=pass_3)  # -> out, a
# ---------- ghpython_script: Python ----------
__author__ = "ATHI"
__version__ = "2024.01.26"

import rhinoscriptsyntax as rs
import time

time.sleep(0.5)

a = x
# ---------- end ghpython_script ----------
ghpython_script_2 = GhPythonScript(x=value_2)  # -> out, a; same code as ghpython_script
gatekeeper_8 = Gatekeeper(Data=value_2, Pass=pass_3, UpdateOutput=False)
gatekeeper_9 = Gatekeeper(Data=ghpython_script_2.a, Pass=ghpython_script.a, UpdateOutput=False)
merge = Merge(Data1=gatekeeper_8, Data2=gatekeeper_9)
data_recorder_4 = DataRecorder(merge, DataLimit=-10, RecordData=True)
panel_8 = Panel(data_recorder_4)

# ----
# In this test, we check whether the component output data is updated.
# The lower one has "Update Output" modifier on, which can be set to true by right-clicking the component.
# The lower one should give a 500 ms delay.
# The top one can show 500 ms in C# component, but there should be no delay in calculation.
boolean_toggle = BooleanToggle(False)
# In this test, we check if the icon color changes based on the pass argument.
# If the Pass is true, the color should be green, otherwise, red.
data_4 = Slider(0, range=0..10)
gatekeeper_10 = Gatekeeper(Data=data_4, Pass=boolean_toggle, UpdateOutput=False)
panel_9 = Panel(gatekeeper_10)

# ----
# In this test, we validate that the data does not propagate, if the gatekeepers are chained in parallel.
# Every data recorder should record only a single value.
value_3 = BooleanToggle(False)
# In this test, we have a delay for the data.
# We want to check whether the second gatekeeper waits for the output of the other.
# The result should give us 2 boolean values which are either both true or false.
# Also, Gatekeeper has had issues with GhPython, and it may not load scriptcontext module. Therefore, this should check whether Python components are compatible with Gatekeeper.
pass_4 = BooleanToggle(False)
gatekeeper_11 = Gatekeeper(Data=value_3, Pass=pass_4, UpdateOutput=False)
gatekeeper_12 = Gatekeeper(Data=value_3, Pass=pass_4, UpdateOutput=False)
gatekeeper_13 = Gatekeeper(Data=value_3, Pass=pass_4, UpdateOutput=False)

merge_2 = Merge(Data1=gatekeeper_11, Data2=gatekeeper_12, Data3=gatekeeper_13)

data_recorder_5 = DataRecorder(merge_2, DataLimit=-10, RecordData=True)
panel_10 = Panel(data_recorder_5)
